# Grasshopper definition Unity-GH-UDP-Plus-Node.gh (Grasshopper 1.0.7)
# plug-ins: MeshStreaming, gHowl

# ---- group: receive the message from Unity
# Geometry transfer between Unity and Grasshopper via UDP
# 
# for more info check the blog at:
# www.aware-studio.com
ip_to_receive_on_this_computer = Panel("192.168.211.145")
port_to_receive_on = Panel("8055")
udp = UDPReceiver(Address=ip_to_receive_on_this_computer, Port=port_to_receive_on, Pattern=0)  # -> Info, Data
panel = Panel(udp.Info)

# ----
# RECEIVE FROM UNITY
the_message_coming_from_unity = Panel(udp.Data)

# ---- group: parse the message
split = TextSplit(Text=udp.Data, Separators=";")
rep = ReplaceText(Text=split, Find="(", Replace="{", RecursiveReplace=False)
rep_2 = ReplaceText(Text=rep, Find=")", Replace="}", RecursiveReplace=False)

# ----
cull_i = CullIndex(List=rep_2, Indices="-1", Wrap=True)

# ---- group: parse the message (continued)
pt = Point(cull_i)

# ----
partition = PartitionList(List=cull_i, Size="3")

# ---- group: reconstruct the Geometry in GH
item = ListItem(List=partition, Index=1, Wrap=True)
pdecon = Deconstruct(Point=item)  # -> XComponent, YComponent, ZComponent
item_2 = ListItem(List=partition, Index=0, Wrap=True)
division = Division(A=pdecon.ZComponent, B="2")
division_2 = Division(A=pdecon.XComponent, B="2")
division_3 = Division(A=pdecon.YComponent, B="2")
dom = ConstructDomain(DomainStart=expr("-x", division), DomainEnd=division)
dom_2 = ConstructDomain(DomainStart=expr("-x", division_2), DomainEnd=division_2)
dom_3 = ConstructDomain(DomainStart=expr("-x", division_3), DomainEnd=division_3)
item_3 = ListItem(List=partition, Index=2, Wrap=True)
box = DomainBox(Base=item_2, X=dom_2, Y=dom_3, Z=dom)

# ----
# in this case the data is
# 0. position of hovered box (xyz)
# 1. sizes of hovered box (xyz)
# 2. hit positon of mouse cursor over the box (xyz)
the_data_as_vectors = Panel(partition)

# ---- group: preview of the box
material = CreateMaterial(
    Diffuse=ColourSwatch(SwatchColor=RGB(0, 255, 255)),
    Specular=RGB(255, 255, 255),
    Emission=RGB(0, 0, 0),
    Transparency=0,
    Shine=0)
wires = BrepWireframe(Brep=box, Density=-1)
# Geometry Postprocessing:
# In the case of this example we use the
# point where the mouse is to split the box
# in 4 smaller boxes each with 25% of the
# volume of the original box
preview = CustomPreview(Geometry=wires, Shader=material)

# ---- group: do something to the geometry
volume = Volume(Geometry=box)  # -> Volume, Centroid
debrep = DeconstructBrep(Brep=box)  # -> Faces, Edges, Vertices
srf_cp = SurfaceClosestPoint(Point=item_3, Surface=reparameterize(debrep.Faces))  # -> Point, UVPoint, Distance
vb = VBScript(x=srf_cp.UVPoint)  # -> out, A; inputs x: Point3d
# ---------- vb: VB ----------
    If x.x <> 0 And x.X <> 1 And x.Y <> 0 And x.Y <> 1 Then
      A = True
    Else 
      a = false
    End If
# ---------- end vb ----------
cull = CullPattern(List=srf_cp.Point, CullPattern=vb.A)
# POST-PROCESS INPUT
number_slider = Slider(0.5, range=0..1)
pline = PolyLine(Vertices=cull, Closed=False)
pframe = PerpFrame(Curve=pline, Parameter=number_slider)
sec = BrepPlane(Brep=box, Plane=pframe)  # -> Curves, Points
cp = ControlPoints(Curve=sec.Curves)  # -> Points, Weights, Knots
curvepoint = PointOnCurve(pline, parameter=0.5)
shift = ShiftList(List=cp.Points, Shift=1, Wrap=False)
plcoord = PlaneCoordinates(Point=shift, System=pframe)  # -> XCoordinate, YCoordinate, ZCoordinate
ln = Line(StartPoint=shift, EndPoint=curvepoint)
curvepoint_2 = PointOnCurve(ln, parameter=0.5)
num = Number(plcoord.XCoordinate)
num_2 = Number(plcoord.YCoordinate)
pl_origin = PlaneOrigin(Base=pframe, Origin=curvepoint_2)
expression = Expression(x=num_2, Expression="abs(x)/2")
expression_2 = Expression(x=num, y=num_2, vol=volume.Volume, Expression="vol/abs(x)/abs(y)/8")
expression_3 = Expression(x=num, Expression="abs(x)/2")
panel_2 = Panel(num_2)
panel_3 = Panel(num)
# Switch Axis For platform
vb_2 = VBScript(x=expression_2)  # -> out, A
# ---------- vb_2: VB ----------
    If x > 10 Then
      A = 10
    Else
      A = x
    End If
# ---------- end vb_2 ----------
panel_4 = Panel(expression_2)
box_2 = CenterBox(Base=pl_origin, X=expression_3, Y=expression, Z=vb_2.A)

# ----
mesh = Mesh(flatten(box_2))

xz = XZPlane(Origin=Point(0, 0, 0))
X = UnitX(Factor=1)
line = LineSDL(Start="0,0,0", Direction=X, Length=1)
rotax = RotateAxis(Geometry=mesh, Angle=1.570796327, Axis=line)  # -> Geometry, Transform
mirror = Mirror(Geometry=rotax.Geometry, Plane=xz)  # -> Geometry, Transform

# ----
# SEND TO UNITY USING NODE method (Mesh Output)
toggle = BooleanToggle(True)
mjoin = MeshJoin(Meshes=mirror.Geometry)
meshserialize = MeshSerialize(Mesh=mjoin)
connectsocket = ConnectSocket(Address="http://localhost:8080", Connect=Toggle(True))  # -> Status, Socket
sendmesh = SendMesh(Bytes=meshserialize, Socket=connectsocket.Socket, TargetEvent="gh", Send=toggle)  # -> Status, Length

panel_5 = Panel(connectsocket.Status)
panel_6 = Panel(sendmesh.Status)
panel_7 = Panel(sendmesh.Length)
